# Grasshopper definition reading_3D_model.ghx (Grasshopper 1.0.8)

compas = Python3Script()  # -> out
# ---------- compas: Python ----------
import compas
print(compas.__version__)
# ---------- end compas ----------

# ----
# 1. Create empty Assembly
# action note: Click this button to create an empty Assembly. Each time you want to start from scratch, reset here by clicking the button again; this creates a new empty Assembly.
button = Button()
# 2. Add parts to Assembly
# info note: Now it is time to add parts to your Assembly.
# You have 2 options:
# 
# either you can add parts from meshes (every part will be unique mesh),
# 
# or you can first create a part with dimensions you want your part to be, and add your parts from breps (this way a part with the same dimension will be created for each brep location).
assembly = Python3Script(init=button)  # -> out, my_assembly
# ---------- assembly: Python ----------
from robotic_bricklaying.assembly import CAEAssembly as Assembly

#create empty assembly
my_assembly = Assembly()
print(my_assembly)
# ---------- end assembly ----------

# ----
# Unload Python modules
# Reading 3D Model
button_2 = Button()
unload = Python3Script(unload=button_2)  # -> out, a
# ---------- unload: Python ----------
#from compas_ghpython.utilities import unload_modules
from compas_rhino import unload_modules

unload_modules('climate_active_envelopes')
unload_modules('assembly_information_model')
# ---------- end unload ----------

panel = Panel("assembly_example.json")
compas___version = Panel(compas)

list = ValueList({"rotate", "translate"}, selected="rotate")
list_2 = ValueList({"clockwise": "right", "counter clockwise": "left"}, selected="clockwise")
transform = Button()
reset = Button()

# ---- group: action
panel_2 = Panel("brick_full")
panel_3 = Panel("0.05")
panel_4 = Panel("0.115")
panel_5 = Panel("0.24")
create = Button()

# ----
# Apply Gradient
values = Python3Script(min_value=Slider(0, range=-0.4..0.1), max_value=Slider(0.5, range=-0.5..1))  # -> normalized_values; inputs results: list
# ---------- values: Python ----------
from compas.itertools import normalize_values



def normalize_to_highest(values, max_value=140.0, target_min=0.1, target_max=1):
    """Normalizes a list of values based on the highest value in the list, 
    scaled to a specific range.

    Args:
    values: A list of numerical values.
    max_value: The expected maximum value. Defaults to 140.0.
    target_min: The minimum value of the target range. Defaults to 0.0.
    target_max: The maximum value of the target range. Defaults to 1.0.

    Returns:
    A list of normalized values.
    """
    highest_value = max(values)

    factor = highest_value / max_value
    print(factor)  # Calculate the scaling factor
    normalized_values = normalize_values(values, target_min, target_max * factor)
    return normalized_values

normalized_values = normalize_values(results, min_value, max_value)
#normalized_values = normalize_to_highest(results)
#print(color_values)

print(max(normalized_values))

print(normalized_values)
# ---------- end values ----------
keys = Python3Script(my_assembly=<missing>, transform_type=list)  # -> out, my_assembly, keys; inputs transform_type: String
# ---------- keys: Python ----------
# for node_id in my_assembly.graph.nodes():
#     transform_type = my_assembly.graph.node_attribute(node_id, 'transform_type')





keys = []
for key in my_assembly.graph.nodes_where({"transform_type": transform_type}):
    keys.append(key)

print(keys)
print(transform_type)
# ---------- end keys ----------
apply_gradient = Python3Script(
    my_assembly=keys.my_assembly,
    normalized_values=values,
    keys=keys.keys,
    transform_type=list,
    rotation_direction=list_2,
    nrbh_size=Slider(2000, range=2..2000),
    transform=transform,
    reset=reset)  # -> out, my_assembly; inputs normalized_values: list, pts: list of Point3d, keys: list, nrbh_size: Int32
# ---------- apply_gradient: Python ----------
from compas_rhino.conversions import point_to_compas



#print(my_assembly.__data__)

transform_types = {node_id: my_assembly.graph.node_attribute(node_id, 'transform_type') for node_id in my_assembly.graph.nodes()}
#print(transform_types)
points = []
for p in pts:
    point = point_to_compas(p)
    points.append(point)

if transform:
    my_assembly.apply_gradient(normalized_values,points,keys,transform_type, rotation_direction, nrbh_size, reset=False)

if reset:
    my_assembly.apply_gradient(normalized_values,points,keys,transform_type, rotation_direction, nrbh_size, reset=True)
# ---------- end apply_gradient ----------

# ----
# Option 1: from meshes
# action note: Right click brick_meshes, click "Set Multiple Meshes", and select your meshes (in correct order). Then click the add button. If you click twice, it will add the same meshes twice. If you select new meshes and click again, it will add the new meshes to the assembly.
add_meshes = Python3Script(add=<missing>, my_assembly=assembly.my_assembly, brick_meshes=<missing>, brick_type=<missing>)  # -> out, my_assembly; inputs brick_meshes: list of Mesh, brick_type: String
# ---------- add_meshes: Python ----------
from climate_active_envelopes.assembly import CAEPart as Part
from compas_rhino.conversions import  mesh_to_compas

if add:
    for m in brick_meshes:
        mesh = mesh_to_compas(m)
        part = Part.from_mesh_and_frame(mesh)
        my_assembly.add_part_from_model(part, attr_dict={"brick_type": brick_type, "transform_type": "fixed"})
# ---------- end add_meshes ----------

# ---- group: action
add = Button()
brick_breps = Brep([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])

# ----
# Option 2: from breps
# action note: Type in the dimensions of your bricks and click the create button. It will create a part with the name you defined. You can do this for as many brick types as you want.
# action note: Right click brick_breps, click "Set Multiple Breps", and select your breps(in correct order) for the locations you want the part to be created in.
add_bricks = Python3Script(add=add, my_assembly=assembly.my_assembly, brick_breps=brick_breps, brick_part=<missing>)  # -> out, my_assembly; inputs brick_breps: list of Brep
# ---------- add_bricks: Python ----------
from robotic_bricklaying.assembly import CAEPart as Part

my_assembly.set_brick_params(brick_part)
print(my_assembly.brick_params)

if add:
    brick_type = brick_part.attributes['name']
    my_assembly.read_model_to_assembly(brick_breps, brick_type, "fixed")
    
print(my_assembly)
# ---------- end add_bricks ----------

# ---- group: action
add_2 = Button()

# ----
compute = Button()

# ----
# 3. Create connections from interfaces
# action note: Click this button to create connections between the parts by computing their interfaces.
boolean_toggle = BooleanToggle(False)
interfaces = Python3Script(add=add_2, my_assembly=[add_bricks.my_assembly, add_meshes.my_assembly], show_intersections=boolean_toggle)  # -> out, my_assembly, meshes
# ---------- interfaces: Python ----------
from compas.geometry import Polygon, Point
from compas_rhino.conversions import mesh_to_rhino
from shapely.geometry import Polygon as ShapelyPolygon



if add:
    courses = my_assembly.assembly_courses()
    print(courses)
    sorted_parts = [part for course in courses for part in course]
    print(sorted_parts)


    polygons = my_assembly.project_part_faces(courses)    
    intersections = my_assembly.compute_polygon_intersections(polygons, courses)
    transformed_intersections = my_assembly.transform_intersections_to_original_course(intersections, courses)
    #transformed_intersections = my_assembly.transform_intersections_to_course_above(intersections, courses)
    my_assembly.set_interface_points()

    # Convert transformed intersections to meshes
    meshes = []
    if show_intersections:

        for key, intersection in transformed_intersections.items():
            mesh = intersection.to_mesh()
            rhino_mesh = mesh_to_rhino(mesh)
            meshes.append(rhino_mesh)




# def project_part_faces(courses):
#     courses = my_assembly.assembly_courses()
#     sorted_parts = [part for course in courses for part in course]
#     polygons = {}
#     for part in sorted_parts:
#         frame_point = my_assembly.graph.node_attributes(part, 'xyz')
#         part = my_assembly.part(part)
#         for face in part.mesh.faces():
#             face_vertices = part.mesh.face_vertices(face)
#             face_coords = [part.mesh.vertex_coordinates(vkey) for vkey in face_vertices]
#             if all(coord[2] == frame_point[2] for coord in face_coords):
#                 target_face = face
#         face_vertices = part.mesh.face_vertices(target_face)
#         vertices = [part.mesh.vertex_coordinates(vkey) for vkey in face_vertices]
#         projected_vertices = [(x, y) for x, y, z in vertices]
#         polygon = Polygon(projected_vertices)
#         polygons[part.key] = polygon
#     return polygons


# def compute_polygon_intersections(polygons, courses):
#     intersections = {}
#     for i in range(len(courses) - 1):
#         current_course = courses[i]
#         next_course = courses[i + 1]
#         for part in current_course:
#             part_polygon = polygons[part]
#             for neighbor in next_course:
#                 neighbor_polygon = polygons[neighbor]
#                 # Convert compas polygons to shapely polygons
#                 shapely_part_polygon = ShapelyPolygon([(point.x, point.y) for point in part_polygon.points])
#                 shapely_neighbor_polygon = ShapelyPolygon([(point.x, point.y) for point in neighbor_polygon.points])
#                 # Compute intersection
#                 intersection = shapely_part_polygon.intersection(shapely_neighbor_polygon)
#                 if not intersection.is_empty:
#                     # Convert shapely intersection back to compas polygon
#                     intersection_coords = list(intersection.exterior.coords)
#                     intersection_points = [Point(x, y, part_polygon.points[0].z) for x, y in intersection_coords]
#                     intersections[(part, neighbor)] = Polygon(intersection_points)
#     return intersections


# def transform_intersections_to_original_course(intersections, courses):
#     transformed_intersections = {}
#     for (part, neighbor), intersection in intersections.items():
#         part_course = next(i for i, course in enumerate(courses) if part in course)
#         neighbor_course = next(i for i, course in enumerate(courses) if neighbor in course)
#         if part_course < neighbor_course:
#             z_coord = my_assembly.graph.node_attribute(part, 'z')
#             transformed_intersection_points = [Point(p.x, p.y, z_coord) for p in intersection.points]
#             transformed_intersections[(part, neighbor)] = Polygon(transformed_intersection_points)
#         else:
#             z_coord = my_assembly.graph.node_attribute(neighbor, 'z')
#             transformed_intersection_points = [Point(p.x, p.y, z_coord) for p in intersection.points]
#             transformed_intersections[(neighbor, part)] = Polygon(transformed_intersection_points)

#         attr = {
#         'interface_type': 'face_face',
#         'interface_points': [(point.x, point.y, point.z) for point in transformed_intersection_points],
#         }
#         my_assembly.graph.add_edge(part, neighbor, attr_dict=attr)

#     return transformed_intersections

# def transform_intersections_to_course_above(intersections, courses):
#     transformed_intersections = {}
#     for (part, neighbor), intersection in intersections.items():
#         neighbor_course = next(i for i, course in enumerate(courses) if neighbor in course)
#         z_coord = my_assembly.graph.node_attribute(neighbor, 'z')
#         transformed_intersection_points = [Point(p.x, p.y, z_coord) for p in intersection.points]
#         transformed_intersections[(part, neighbor)] = Polygon(transformed_intersection_points)

#         attr = {
#             'interface_type': 'face_face',
#             'interface_points': [(point.x, point.y, point.z) for point in transformed_intersection_points],
#         }
#         my_assembly.graph.add_edge(part, neighbor, attr_dict=attr)

#     return transformed_intersections


# def set_interface_points(my_assembly):
#     for key in my_assembly.graph.nodes():
#         part = my_assembly.part(key)
#         frame_point = my_assembly.graph.node_attributes(key, 'xyz')
#         part = my_assembly.part(key)
#         for face in part.mesh.faces():
#             face_vertices = part.mesh.face_vertices(face)
#             face_coords = [part.mesh.vertex_coordinates(vkey) for vkey in face_vertices]
#             if all(coord[2] == frame_point[2] for coord in face_coords):
#                 target_face = face
#         face_vertices = part.mesh.face_vertices(target_face)
#         vertices = [part.mesh.vertex_coordinates(vkey) for vkey in face_vertices]
#         projected_vertices = [(x, y) for x, y, z in vertices]
#         polygon = Polygon(projected_vertices)
#         my_assembly.graph.node_attribute(key, 'interface_points', projected_vertices)
# ---------- end interfaces ----------
mesh = Mesh(interfaces.meshes)

y_axis = Curve(<curve referenced from the Rhino model>)
x_axis = Curve(<curve referenced from the Rhino model>)
plane = Python3Script(plane_axes=[x_axis, y_axis])  # -> out, plane, sphere; inputs plane_axes: list of Curve
# ---------- plane: Python ----------
import Rhino.Geometry as rg
from compas_rhino.conversions import  plane_to_compas_frame, sphere_to_rhino
from compas.geometry import Sphere

x_axis, y_axis = plane_axes



x_axis = rg.Line(x_axis.PointAtStart, x_axis.PointAtEnd)
y_axis = rg.Line(y_axis.PointAtStart, y_axis.PointAtEnd)

if x_axis.From.DistanceTo(y_axis.From) < 0.01:
    origin = x_axis.From
    xvec = x_axis.Direction
    yvec = y_axis.Direction
elif x_axis.To.DistanceTo(y_axis.To) < 0.01:
    origin = x_axis.To
    xvec = -x_axis.Direction
    yvec = -y_axis.Direction
elif x_axis.From.DistanceTo(y_axis.To) < 0.01:
    origin = x_axis.From
    xvec = x_axis.Direction
    yvec = -y_axis.Direction
elif x_axis.To.DistanceTo(y_axis.From) < 0.01:
    origin = x_axis.To
    xvec = -x_axis.Direction
    yvec = y_axis.Direction

plane = rg.Plane(origin, xvec, yvec)

compas_sphere = Sphere(frame = plane_to_compas_frame(plane), radius=1.5)
sphere = sphere_to_rhino(compas_sphere)
# ---------- end plane ----------

show_all = BooleanToggle(False)
show_connections = BooleanToggle(True)
show_until_key = BooleanToggle(False)
show_course = BooleanToggle(False)
show_neighbors = BooleanToggle(False)
show_patch = BooleanToggle(False)
show_patches = BooleanToggle(True)
highlight_current_part = BooleanToggle(True)

start = Button()
stop = Button()
step = Button()
back = Button()
reset_2 = Button()
full = Button()
list_3 = ValueList({"20", "50", "100", "500", "1000", "5000"}, selected="50")

# ---- group: action
panel_6 = Panel("assembly_example")
export = Button()

# ----
# 4. Export to JSON
# action note: Click this button to generate a json file of your assembly. Change the name for each file.
path = Python3Script()  # -> HERE, ASSEMBLY, DATA
# ---------- path: Python ----------
import os

HERE = os.path.dirname(ghdoc.Path)
DATA = os.path.abspath(os.path.join(HERE, "..", "data"))
ASSEMBLY = os.path.abspath(os.path.join(DATA, "assembly"))

print(HERE)
print(DATA)
print(ASSEMBLY)
# ---------- end path ----------
export_2 = Python3Script(ASSEMBLY=path.ASSEMBLY, DATA=path.DATA, filename=panel_6, my_assembly=interfaces.my_assembly, export_assembly=export)  # -> out; inputs ASSEMBLY: String
# ---------- export_2: Python ----------
import os
import json
from compas.datastructures import Assembly
from scriptcontext import sticky as st
from robotic_bricklaying.assembly import CAEAssembly

if export_assembly:
    filename_assembly = filename + ".json"
    PATH_assembly = os.path.join(ASSEMBLY, filename_assembly)
    my_assembly.to_json(PATH_assembly, pretty=True)
    print(f"Assembly exported to {PATH_assembly}")
    print(my_assembly)
# ---------- end export_2 ----------

counter = Python3Script(
    my_assembly=interfaces.my_assembly,
    start=start,
    stop=stop,
    step=step,
    step_back=back,
    reset=reset_2,
    full=full,
    interval=list_3)  # -> out, node_key, counter
# ---------- counter: Python ----------
from scriptcontext import sticky as st
import Grasshopper

courses = my_assembly.assembly_courses(tol= 0.0001)
#courses = my_assembly.assembly_courses_xy(tol= 0.0001)
#courses = (my_assembly.assembly_courses_xyz(tol= 0.0001, z_tol = 0.1))


L = [node for course in courses for node in course]
# print(L)



def update_component(ghenv, delay):
    """Schedule an update of the Grasshopper component.

    After the specified delay, the GH component will be automatically updated.

    Parameters
    ----------
    ghenv : :class:`GhPython.Component.PythonEnvironment`
        The current GHPython environment.
    delay : :obj:`int`
        Time in milliseconds until the update is performed.

    Raises
    ------
    ValueError
        If the delay is less than zero.

    """
    if delay <= 0:
        raise ValueError("Delay must be greater than zero")

    ghcomp = ghenv.Component
    ghdoc = ghcomp.OnPingDocument()

    def callback(ghdoc):
        if ghdoc.SolutionState != Grasshopper.Kernel.GH_ProcessStep.Process:
            ghcomp.ExpireSolution(False)

    ghdoc.ScheduleSolution(delay, Grasshopper.Kernel.GH_Document.GH_ScheduleDelegate(callback))




guid = str(ghenv.Component.InstanceGuid)
counter_key = "counter_" + guid
running_key = "running_" + guid

if counter_key not in st:
    st[counter_key] = 0

if running_key not in st:
    st[running_key] = False

if st[running_key]:
    if st[counter_key] < len(L) - 1:
        st[counter_key] += 1
        update_component(ghenv, interval)
    else:
        st[counter_key] = 0
        st[running_key] = False

if start:
    st[running_key] = True

if stop:
    st[running_key] = False

if step:
    if st[counter_key] < len(L) - 1:
        st[counter_key] += 1

if step_back:
    if st[counter_key] < len(L) - 1:
        st[counter_key] -= 1

if reset:
    st[counter_key] = 0
    st[running_key] = False

if full:
    st[counter_key] = len(L) - 1

if len(L):
    node_key = L[st[counter_key]]
    print(f"Current node item: {node_key}")

#st["visualisation_counter"] = st[counter_key]
counter = st[counter_key] #+ 1

print(L)
# ---------- end counter ----------
panel_7 = Panel(counter.counter)

list_4 = ValueList({"1", "2", "3", "4", "5", "6", "7", "8", "9"}, selected="9")
visualize = Python3Script(
    my_assembly=interfaces.my_assembly,
    show_all=show_all,
    show_connections=show_connections,
    show_until_key=show_until_key,
    show_course=show_course,
    show_neighbors=show_neighbors,
    show_patch=show_patch,
    node_key=counter.node_key,
    show_patch_until_counter=<missing>,
    show_patches=show_patches,
    highlight_current_part=highlight_current_part,
    step=<missing>,
    step_back=<missing>,
    reset=<missing>,
    patch_idx=list_4)  # -> out, parts_geometry, brick_full_geometry, brick_insulated_geometry, brick_air_dried_geometry, parts_frame, current_part_geometry, current_part_frame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; inputs patch_idx: Int32
# ---------- visualize: Python ----------
from compas_rhino.conversions import mesh_to_rhino, box_to_rhino, frame_to_rhino
from compas.colors import Color
import Rhino.Geometry as rg
import ghpythonlib.components as ghcomp
from scriptcontext import sticky as st

courses = my_assembly.assembly_courses(tol= 0.0001)

#courses = my_assembly.assembly_courses_xyz(tol= 0.0001, z_tol = 0.1)
#courses = my_assembly.assembly_courses_xy(tol= 0.0001)

L = [node for course in courses for node in course]


G_neighbors = []
G_connections = []
G_course = []
G_patch = []
G_patches =  []
G_sequence_wtop_key = []
G_patches_color = []


key_index = my_assembly.graph.node_index()
keys = [key_index[key] for key in my_assembly.graph.nodes()]
#key = node_key

#get parts datastructure
parts = [p for p in my_assembly.parts()]
brick_full_parts = [p for p in parts if my_assembly.graph.node_attribute(p.key, "brick_type") == "brick_full"]
brick_insulated_parts = [p for p in parts if my_assembly.graph.node_attribute(p.key, "brick_type") == "brick_insulated"]
brick_air_dried_parts = [p for p in parts if my_assembly.graph.node_attribute(p.key, "brick_type") == "brick_air_dried"]

if show_all:

    brick_full_geometry = []
    brick_insulated_geometry = []
    brick_air_dried_geometry = []
    parts_frame = []

    parts_geometry = [mesh_to_rhino(p.mesh) for p in parts]
    brick_full_geometry = [mesh_to_rhino(p.mesh) for p in brick_full_parts]
    brick_insulated_geometry = [mesh_to_rhino(p.mesh) for p in brick_insulated_parts]
    brick_air_dried_geometry = [mesh_to_rhino(p.mesh) for p in brick_air_dried_parts]

    parts_frame = [frame_to_rhino(p.frame) for p in parts]
    key = my_assembly.graph.number_of_nodes()-1
else:
    current_index = L.index(node_key)
    parts_geometry = [mesh_to_rhino(parts[key].mesh) for key in L[:current_index + 1]]
    parts_frame = [frame_to_rhino(parts[key].frame) for key in L[:current_index + 1]]
    key = node_key

if show_connections:
    edges = list(my_assembly.connections())
    for e in edges:
        part1 = my_assembly.part(e[0])
        part2 = my_assembly.part(e[1])
        if not hasattr(part1.frame, 'point') or not hasattr(part2.frame, 'point'):
            print(f"Missing frame point for edge: {e}")
            continue
        p1 = part1.frame.point
        p2 = part2.frame.point
        G_connections += [rg.Line(p1[0], p1[1], p1[2], p2[0], p2[1], p2[2])]

        # p1 = my_assembly.part(e[0]).frame.point
        # p2 = my_assembly.part(e[1]).frame.point
        # G_connections += [rg.Line(p1[0],p1[1],p1[2],p2[0],p2[1],p2[2])]

if show_neighbors:
    nbrs = [key_index[key] for key in my_assembly.graph.neighbors(key=node_key)]
    parts = [my_assembly.part(key) for key in nbrs]
    for p in parts:
        G_neighbors.append(mesh_to_rhino(p.mesh))

if show_course:
    total_courses = max(my_assembly.graph.nodes_attribute('course')) + 1
    course = my_assembly.graph.node_attribute(key=node_key, name='course')
    keys_in_course = list(my_assembly.graph.nodes_where({'course': course}))
    parts = [my_assembly.part(key) for key in keys_in_course]
    for p in parts:
        G_course.append(mesh_to_rhino(p.mesh))

if highlight_current_part:
    current_part = my_assembly.part(key)
    current_part_geometry = mesh_to_rhino(current_part.mesh)
    current_part_frame = frame_to_rhino(current_part.frame)
    current_part_gripping_frame = frame_to_rhino(current_part.gripping_frame)
    print(current_part.__data__)
    
print(my_assembly)
# ---------- end visualize ----------

geo = Geometry(visualize.parts_geometry)
geo_2 = Geometry([visualize.brick_full_geometry, visualize.parts_geometry])
geo_3 = Geometry(visualize.current_part_gripping_frame)
geo_4 = Geometry([visualize.current_part_geometry, visualize.G_connections, visualize.G_course])
geo_5 = Geometry(visualize.G_patches)
preview = CustomPreview(Geometry=geo, Material=ColourSwatch(SwatchColor=RGB(196, 141, 141)))
preview_2 = CustomPreview(Geometry=geo_2, Material=ColourSwatch(SwatchColor=RGB(196, 141, 141)))  # disabled
preview_3 = CustomPreview(Geometry=geo_4, Material=ColourSwatch(SwatchColor=RGB(204, 103, 157)))
preview_4 = CustomPreview(Geometry=geo_3, Material=ColourSwatch(SwatchColor=RGB(246, 202, 157)))
preview_5 = CustomPreview(Geometry=geo_5, Material=visualize.G_patches_color)
geo_6 = Geometry(visualize.G_neighbors)
preview_6 = CustomPreview(Geometry=geo_6, Material=ColourSwatch(SwatchColor=RGB(246, 131, 141)))
geo_7 = Geometry(visualize.brick_insulated_geometry)
geo_8 = Geometry(visualize.G_patch)
geo_9 = Geometry([visualize.parts_frame, visualize.current_part_frame])
preview_7 = CustomPreview(Geometry=geo_9, Material=ColourSwatch(SwatchColor=RGB(255, 125, 157)))
geo_10 = Geometry(visualize.brick_air_dried_geometry)
preview_8 = CustomPreview(Geometry=geo_7, Material=ColourSwatch(SwatchColor=RGB(177, 142, 141)))  # disabled
preview_9 = CustomPreview(Geometry=geo_10, Material=ColourSwatch(SwatchColor=RGB(204, 160, 55)))  # disabled
preview_10 = CustomPreview(Geometry=geo_8, Material=ColourSwatch(SwatchColor=RGB(246, 131, 141)))

# ----
# Visualisation
panel_8 = Panel(visualize.out)
draw = Python3Script(planes=geo_3, scale=Slider(0.2, range=0..1))  # -> out, P, V, C, W; inputs planes: list of Plane
# ---------- draw: Python ----------
from System.Drawing import Color

red = Color.FromArgb(255, 0, 0)
green = Color.FromArgb(0, 255, 0)
blue = Color.FromArgb(0, 0, 255)

P = []
V = []
C = []

scale = float(scale)

for plane in planes:
    if not plane:
        continue
    P += [plane.Origin] * 3
    V.append(plane.XAxis * scale)
    V.append(plane.YAxis * scale)
    V.append(plane.ZAxis * scale)
    C += [red, green, blue]

W = 3
# ---------- end draw ----------
vdisex = VectorDisplayEx(Point=draw.P, Vector=draw.V, Colour=draw.C, Width=draw.W)
pln = Plane(visualize.current_part_gripping_frame)
